# Grasshopper definition pc [May-22 '23, 2100].gh (Grasshopper 1.0.7)
# plug-ins: LunchBox, Wombat, NGon, Human

pipeline = GeometryPipeline(
    GroupByLayer=False,
    GroupByType=False,
    IncludeHidden=True,
    IncludeLocked=True,
    LayerFilter="*bbox",
    NameFilter="*",
    SublayerFiltering=True,
    TypeFilter=1073741848)
debrep = DeconstructBrep(Brep=pipeline)  # -> Faces, Edges, Vertices
pipeline_2 = GeometryPipeline(
    GroupByLayer=False,
    GroupByType=False,
    IncludeHidden=True,
    IncludeLocked=True,
    LayerFilter="nonfixed",
    NameFilter="*",
    SublayerFiltering=True,
    TypeFilter=4)
bbox = BoundingBox(Content=pipeline, Plane=PlaneXY(0, 0, 0))  # -> Box, Box_2
pipeline_3 = GeometryPipeline(
    GroupByLayer=False,
    GroupByType=False,
    IncludeHidden=True,
    IncludeLocked=True,
    LayerFilter="fixed",
    NameFilter="*",
    SublayerFiltering=True,
    TypeFilter=4)
debox = DeconstructBox(Box=bbox.Box)  # -> Plane, X, Y, Z
dedomain = DeconstructDomain(Domain=debox.Z)  # -> Start, End
panel = Panel(debrep.Vertices)
dedomain_2 = DeconstructDomain(Domain=debox.Y)  # -> Start, End
merge = Merge(Data1=pipeline_3, Data2=pipeline_2)
subtraction = Subtraction(A=dedomain.End, B=dedomain.Start)
number_slider = Slider(1000, range=0..1000)
dedomain_3 = DeconstructDomain(Domain=debox.X)  # -> Start, End
number_slider_2 = Slider(10, range=10..1000)
crv = Curve(merge)
explode = Explode(Curve=crv, Recursive=True)  # -> Segments, Vertices
pdecon = Deconstruct(Point=explode.Vertices)  # -> XComponent, YComponent, ZComponent
subtraction_2 = Subtraction(A=dedomain_2.End, B=dedomain_2.Start)
multiplication = Multiplication(A=pdecon.XComponent, B=number_slider)
subtraction_3 = Subtraction(A=dedomain_3.End, B=dedomain_3.Start)
number_slider_3 = Slider(0.1, range=0.01..0.1)
multiplication_2 = Multiplication(A=pdecon.YComponent, B=number_slider)
multiplication_3 = Multiplication(A=pdecon.ZComponent, B=number_slider)
lng = ListLength(List=pipeline_3)
lng_2 = ListLength(List=pipeline_2)
round = Round(Number=multiplication)  # -> Nearest, Floor, Ceiling
voxels = Voxels(Scale=1)
round_2 = Round(Number=multiplication_2)  # -> Nearest, Floor, Ceiling
round_3 = Round(Number=multiplication_3)  # -> Nearest, Floor, Ceiling
popgeo = PopulateGeometry(Geometry=pipeline, Count=100, Seed=1)
division = Division(A=round.Nearest, B=number_slider)
end = EndPoints(Curve=explode.Segments)  # -> Start, End
division_2 = Division(A=round_2.Nearest, B=number_slider)
division_3 = Division(A=round_3.Nearest, B=number_slider)
range = Range(Domain=debox.X, Steps=subtraction_3)
range_2 = Range(Domain=debox.Y, Steps=subtraction_2)
range_3 = Range(Domain=debox.Z, Steps=subtraction)
pt = ConstructPoint(XCoordinate=division, YCoordinate=division_2, ZCoordinate=division_3)
sort_pts = SortDuplicatePoints(Points=flatten(pt))  # -> UniquePoints, Indices
cp = ClosestPoint(Point=explode.Vertices, Cloud=sort_pts.UniquePoints)  # -> ClosestPoint, CPIndex, Distance
pipeline_4 = GeometryPipeline(
    GroupByLayer=False,
    GroupByType=False,
    IncludeHidden=True,
    IncludeLocked=True,
    LayerFilter="densityboxes::middensity",
    NameFilter="*",
    SublayerFiltering=True,
    TypeFilter=1073741848)
pipeline_5 = GeometryPipeline(
    GroupByLayer=False,
    GroupByType=False,
    IncludeHidden=True,
    IncludeLocked=True,
    LayerFilter="densityboxes::highdensity",
    NameFilter="*",
    SublayerFiltering=True,
    TypeFilter=1073741848)
pipeline_6 = GeometryPipeline(
    GroupByLayer=False,
    GroupByType=False,
    IncludeHidden=True,
    IncludeLocked=True,
    LayerFilter="densityboxes::nodensity",
    NameFilter="*",
    SublayerFiltering=True,
    TypeFilter=1073741848)
cp_2 = ClosestPoint(Point=explode.Vertices, Cloud=sort_pts.UniquePoints)  # -> ClosestPoint, CPIndex, Distance
series = Series(Start=debox.X, Step=1, Count=10)
addition = Addition(A=cp.CPIndex, B=1)
crossref = CrossReference(ListA=range, ListB=range_2, CrossMode=1)  # -> ListA, ListB
repeat = RepeatData(Data=Slider(1, range=0..100), Length=lng)
repeat_2 = RepeatData(Data=Slider(0, range=0..1), Length=lng_2)
item = ListItem(List=addition, Index=0, Wrap=True)  # -> simplify(Item)
item_2 = ListItem(List=addition, Index=1, Wrap=True)  # -> simplify(Item)
pt_2 = ConstructPoint(XCoordinate=crossref.ListA, YCoordinate=crossref.ListB, ZCoordinate=graft(range_3))  # -> flatten(Point)
pdecon_2 = Deconstruct(Point=sort_pts.UniquePoints)  # -> XComponent, YComponent, ZComponent
lng_3 = ListLength(List=pt_2)
merge_2 = Merge(Data1=repeat, Data2=repeat_2)
brepsinc = PointInBreps(Brep=pipeline_4, Point=pt_2, Strict=False)  # -> Inside, Index
createatts = CreateAttributes(enableFullPath=False)
brepsinc_2 = PointInBreps(Brep=pipeline_5, Point=pt_2, Strict=False)  # -> Inside, Index
concat = Concatenate(FragmentA="l", FragmentB=item, FragmentC=item_2, FragmentD=graft(merge_2), JoinSeparator=" ")  # -> flatten(Result)
brepsinc_3 = PointInBreps(Brep=pipeline_6, Point=pt_2, Strict=False)  # -> Inside, Index
repeat_3 = RepeatData(Data=Slider(0.05, range=0..1), Length=lng_3)
dpipeline = DynamicGeometryPipeline(
    LayerFilter="points*",
    TypeFilter="Point",
    NameFilter="*",
    GroupByLayer=False,
    GroupByType=False,
    IncludeHidden=True,
    IncludeLocked=True,
    enableFullPath=True,
    listenToAttributes=True)
concat_2 = Concatenate()
cull = CullPattern(List=pt_2, CullPattern=brepsinc_2.Inside)
cp_3 = ClosestPoint(Point=sort_pts.UniquePoints, Cloud=dpipeline)  # -> ClosestPoint, CPIndex, Distance
not = GateNot(A=brepsinc_3.Inside)
num = Number(not)
num_2 = Number(brepsinc.Inside)
num_3 = Number(brepsinc_2.Inside)
objatts = ObjectAttributes(ObjectOrAttributes=dpipeline)  # -> Name, LayerName, LayerFullPath, Color, MaterialName, LinetypeName, GroupIndices, PlotWeight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
max = Maximum(A=repeat_3, B=num_3)
multiplication_4 = Multiplication()
pt_3 = Point([<point referenced from the Rhino model> x15])
multiplication_5 = Multiplication(A=num_2, B=Slider(0.4, range=0..1))
vec = Vector(pt_3)
max_2 = Maximum(A=max, B=multiplication_5)
expression = Expression(x=objatts.LayerName, y="unfixed", Expression="if(x=y,0,1)")
item_3 = ListItem(List=expression, Index=cp_3.CPIndex, Wrap=True)  # -> simplify(flatten(Item))
concat_3 = Concatenate(
    FragmentA="v",
    FragmentB=pdecon_2.XComponent,
    FragmentC=pdecon_2.ZComponent,
    FragmentD=pdecon_2.YComponent,
    FragmentE=item_3,
    JoinSeparator=" ")
merge_3 = Merge(Data1=concat_3, Data3=concat)
panel_2 = Panel(concat_3)
min = Minimum(A=max_2, B=num)
number_slider_4 = Slider(100, range=0..100)  # disabled
multiplication_6 = Multiplication(A=min, B=255)  # disabled
panel_3 = Panel(vec)
panel_4 = Panel(item_3)
pdecon_3 = Deconstruct(Point=pt_2)  # -> XComponent, YComponent, ZComponent
rgb = ColourRGB(Alpha=number_slider_4, Red=multiplication_6, Green=multiplication_6, Blue=multiplication_6)  # disabled
number_slider_5 = Slider(0.213, range=0.001..1)  # disabled
panel_5 = Panel("D:\Dokumente\Uni\programmieren\cindertesting\experiments\pointcloud\")
panel_6 = Panel("\")
int = Integer(pdecon_3.XComponent)
int_2 = Integer(pdecon_3.YComponent)
int_3 = Integer(pdecon_3.ZComponent)
cloud = CloudDisplay(Points=pt_2, Colours=rgb, Size=number_slider_5, SpriteType=1)  # disabled
panel_7 = Panel(".obj")
concat_4 = Concatenate(FragmentA=int, FragmentB=int_3, FragmentC=int_2, FragmentD=min, JoinSeparator=",")
button = Button()
brep = Brep(<brep referenced from the Rhino model>)
popgeo_2 = PopulateGeometry(Geometry=brep, Count=100, Seed=1)
pipeline_7 = GeometryPipeline(
    GroupByLayer=False,
    GroupByType=False,
    IncludeHidden=True,
    IncludeLocked=True,
    LayerFilter="anchorpointsdense",
    NameFilter="*",
    SublayerFiltering=True,
    TypeFilter=1)
pt_4 = Point([<point referenced from the Rhino model> x7])
python = GhPythonScript()  # -> out, a
# ---------- python: Python ----------
__author__ = "ed"
__version__ = "2023.04.24"

import rhinoscriptsyntax as rs
a = ghenv.Component.OnPingDocument().FilePath

#a = "hello"
# ---------- end python ----------
pdecon_4 = Deconstruct(Point=pipeline_7)  # -> XComponent, YComponent, ZComponent
split = TextSplit(Text=python.a, Separators="\")
int_4 = Integer(pdecon_4.XComponent)
int_5 = Integer(pdecon_4.YComponent)
split_2 = SplitList(List=reverse(split), Index=1)  # -> ListA, reverse(simplify(flatten(ListB)))
int_6 = Integer(pdecon_4.ZComponent)
concat_5 = Concatenate(FragmentA=int_4, FragmentB=int_6, FragmentC=int_5, JoinSeparator=",")
join = TextJoin(Text=split_2.ListB, Join="\")
panel_11 = Panel(concat_5)
concat_6 = Concatenate(FragmentA=join, FragmentB="\")
path = FilePath(concat_6)
concat_7 = Concatenate(FragmentA=path, FragmentC="initialgraph", FragmentD=".txt")
writetxt = WriteToTextFile(Run=button, TextToWrite=merge_3, FilePath=concat_7, Append=False, NewOnly=False)
concat_8 = Concatenate(FragmentA=path, FragmentC="voxels", FragmentD=".txt")
writetxt_2 = WriteToTextFile(Run=[button, Button()], TextToWrite=concat_4, FilePath=concat_8, Append=False, NewOnly=False)
concat_9 = Concatenate(FragmentA=path, FragmentC="anchorpoints", FragmentD=".txt")
panel_12 = Panel(writetxt)
panel_13 = Panel(writetxt_2)
writetxt_3 = WriteToTextFile(Run=Button(), TextToWrite=concat_5, FilePath=concat_9, Append=False, NewOnly=False)
