# Grasshopper definition korrekt.gh (Grasshopper 1.0.7)
# plug-ins: LunchBox

number_slider = Slider(0, range=0..10)
number_slider_2 = Slider(10, range=0..10)
pt = Point([<point referenced from the Rhino model> x5000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])
lng = ListLength(List=pt)
random = Random(Range=Slider(647, range=0..1000), Number=lng, Seed=2)
brep = Brep(<brep referenced from the Rhino model>)
int = Integer(random)
bool = Boolean(int)
dispatch = Dispatch(List=pt, DispatchPattern=bool)  # -> ListA, ListB
pt_2 = Point(dispatch.ListB)
brepinc = PointInBrep(Brep=brep, Point=pt_2, Strict=False)
file = ReadFile(File="D:\Dokumente\Uni\programmieren\cindertesting\experiments\anleitungnetz\edges.csv", PerLineParse=True)
dispatch_2 = Dispatch(List=pt_2, DispatchPattern=brepinc)  # -> ListA, ListB
csv = ReadCSV(CSVString=file, Delimiter=",")  # -> Headers, Values
pt_3 = Point(dispatch_2.ListA)
number_slider_3 = Slider(500, range=0..1000)
number_slider_4 = Slider(100, range=0..100)
bang = ExplodeTree(Data=csv.Values)  # -> Branch0, Branch1, Branch2, Branch3, Branch4, Branch5
number_slider_5 = Slider(20, range=0..100)
number_slider_6 = Slider(19, range=0..100)
partition = PartitionList(List=bang.Branch2, Size=[3, 2])
rectangle = Rectangle(Plane=PlaneXY(0, 0, 0), XSize=number_slider_3, YSize=number_slider_3, Radius=0)  # -> Rectangle, Length
grid = GridStructure(Surface=rectangle.Rectangle, UDivisions=number_slider_6, VDivisions=number_slider_6)  # -> StructureLines, StructureNodes
X = UnitX(Factor=1)
xz = XZPlane(Origin=Point(0, 0, 0))
mirror = Mirror(Geometry=grid.StructureNodes, Plane=xz)  # -> Geometry, Transform
item = ListItem(List=mirror.Geometry, Index=Slider(96, range=1..400), Wrap=True)
line = LineSDL(Start=mirror.Geometry, Direction=X, Length=bang.Branch2)
