# Grasshopper definition sparse.gh (Grasshopper 1.0.7)

number_slider = Slider(102, range=1..1000)
crv = Curve([<curve referenced from the Rhino model> x3])
number_slider_2 = Slider(234, range=1..1000)  # disabled
number_slider_3 = Slider(0, range=0..10)
crv_2 = Curve([<curve referenced from the Rhino model> x8])  # disabled
multiplication = Multiplication(A=number_slider_2, B=2)  # disabled
lng = ListLength()  # disabled
number_slider_4 = Slider(8, range=0..10)
crv_3 = Curve([<curve referenced from the Rhino model> x10])
division = Division(B=2)  # disabled
len = Length(Curve=crv_2)  # disabled
crv_4 = Curve([<curve referenced from the Rhino model> x9])
crv_5 = Curve([<curve referenced from the Rhino model> x7])
crv_6 = Curve([<curve referenced from the Rhino model> x13])
ma = MassAddition(Input=len)  # -> Result, PartialResults; disabled
random = Random(Range=ma.Result, Number=multiplication, Seed=2)  # disabled
split = SplitList(List=random, Index=number_slider_2)  # -> flatten(ListA), flatten(ListB); disabled
crv_7 = Curve([<curve referenced from the Rhino model> x9])
crv_8 = Curve([<curve referenced from the Rhino model> x7])
crv_9 = Curve([<curve referenced from the Rhino model> x6])
crv_10 = Curve([<curve referenced from the Rhino model> x6])
crv_11 = Curve([<curve referenced from the Rhino model> x6])
crv_12 = Curve([<curve referenced from the Rhino model> x9])
crv_13 = Curve([<curve referenced from the Rhino model> x8])
crv_14 = Curve([<curve referenced from the Rhino model> x11])
crv_15 = Curve([<curve referenced from the Rhino model> x10])
subtraction = Subtraction(A=ma.PartialResults, B=len)  # disabled
crv_16 = Curve([<curve referenced from the Rhino model> x6])
crv_17 = Curve([<curve referenced from the Rhino model> x6])
crv_18 = Curve([<curve referenced from the Rhino model> x5])
crv_19 = Curve([<curve referenced from the Rhino model> x6])
cluster = Cluster(i=number_slider, S=number_slider_4, L=crv_3)
panel = Panel(subtraction)  # disabled
crv_20 = Curve([<curve referenced from the Rhino model> x7])
panel_2 = Panel(ma.PartialResults)  # disabled
crv_21 = Curve([<curve referenced from the Rhino model> x5])
cluster_2 = Cluster(i=number_slider, S=number_slider_4, L=crv_4)
cluster_3 = Cluster(i=number_slider, S=number_slider_4, L=crv_5)
cluster_4 = Cluster(i=number_slider, S=Slider(10, range=0..10), L=crv_13)
crv_22 = Curve([<curve referenced from the Rhino model> x11])
cluster_5 = Cluster(i=number_slider, S=number_slider_4, L=crv_10)
cluster_6 = Cluster(i=number_slider, S=number_slider_4, L=crv_8)
cluster_7 = Cluster(i=number_slider, S=number_slider_4, L=crv_9)
crv_23 = Curve([<curve referenced from the Rhino model> x7])
crv_24 = Curve([<curve referenced from the Rhino model> x10])
dom = ConstructDomain(DomainStart=subtraction, DomainEnd=ma.PartialResults)  # disabled
crv_25 = Curve([<curve referenced from the Rhino model> x7])
crv_26 = Curve([<curve referenced from the Rhino model> x8])
cluster_8 = Cluster(i=number_slider, S=number_slider_4, L=crv_14)
cluster_9 = Cluster(i=number_slider, S=number_slider_4, L=crv_15)
crv_27 = Curve([<curve referenced from the Rhino model> x13])
cluster_10 = Cluster(i=number_slider, S=number_slider_4, L=crv_6)
inc = Includes(Value=graft(split.ListA), Domain=simplify(dom))  # -> simplify(Includes), Deviation; disabled
cluster_11 = Cluster(i=number_slider, S=number_slider_4, L=crv_18)
cluster_12 = Cluster(i=number_slider, S=number_slider_4, L=crv_16)
cluster_13 = Cluster(i=number_slider, S=number_slider_4, L=crv_7)
cluster_14 = Cluster(i=number_slider, S=number_slider_4, L=crv_17)
cluster_15 = Cluster(i=number_slider, S=number_slider_4, L=crv_19)
cluster_16 = Cluster(i=number_slider, S=number_slider_4, L=crv_11)
dedomain = DeconstructDomain(Domain=dom)  # -> Start, End; disabled
crv_28 = Curve([<curve referenced from the Rhino model> x10])
cluster_17 = Cluster(i=number_slider, S=number_slider_4, L=crv_20)
cluster_18 = Cluster(i=number_slider, S=number_slider_4, L=crv_12)
crv_29 = Curve([<curve referenced from the Rhino model> x10])
cluster_19 = Cluster(i=number_slider, S=number_slider_4, L=crv_21)
crv_30 = Curve([<curve referenced from the Rhino model> x4])
subtraction_2 = Subtraction(A=graft(dedomain.Start), B=split.ListA)  # disabled
cluster_20 = Cluster(i=number_slider, S=number_slider_4, L=crv_22)
crv_31 = Curve([<curve referenced from the Rhino model> x6])
crv_32 = Curve([<curve referenced from the Rhino model> x2])
item = ListItem(List=inc.Includes, Index=0, Wrap=True)  # disabled
cluster_21 = Cluster(i=number_slider, S=number_slider_4, L=crv_23)
subtraction_3 = Subtraction(A=dedomain.End, B=split.ListA)  # disabled
cluster_22 = Cluster(i=number_slider, S=number_slider_4, L=crv_24)
cluster_23 = Cluster(i=number_slider, S=number_slider_4, L=crv_25)
cluster_24 = Cluster(i=number_slider, S=number_slider_4, L=crv_26)
crv_33 = Curve([<curve referenced from the Rhino model> x11])
cluster_25 = Cluster(i=number_slider, S=number_slider_4, L=crv_27)
division_2 = Division(A=subtraction_2, B=subtraction_3)  # disabled
cluster_26 = Cluster(i=number_slider, S=number_slider_4, L=crv_29)
cluster_27 = Cluster(i=number_slider, S=number_slider_4, L=crv_30)
cluster_28 = Cluster(i=number_slider, S=number_slider_4, L=crv_28)
crv_34 = Curve([<curve referenced from the Rhino model> x11])
cluster_29 = Cluster(i=number_slider, S=number_slider_4, L=crv_31)
crv_35 = Curve([<curve referenced from the Rhino model> x6])
cluster_30 = Cluster(i=number_slider, S=number_slider_4, L=crv_32)
crv_36 = Curve([<curve referenced from the Rhino model> x5])
crv_37 = Curve([<curve referenced from the Rhino model> x7])
cluster_31 = Cluster(i=number_slider, S=number_slider_4, L=crv_33)
crv_38 = Curve(cluster_4)
cluster_32 = Cluster(i=number_slider, S=number_slider_4, L=crv_34)
cluster_33 = Cluster(i=number_slider, S=number_slider_4, L=crv_35)
cluster_34 = Cluster(i=number_slider, S=number_slider_4, L=crv_36)
cluster_35 = Cluster(i=number_slider, S=number_slider_4, L=crv_37)
line = Line()
merge = Merge(
    Data1=cluster_32,
    Data2=cluster_31,
    Data3=cluster_30,
    Data4=cluster_29,
    Data5=cluster_27,
    Data6=cluster_26,
    Data7=cluster_28,
    Data8=cluster_25,
    Data9=cluster_24,
    Data10=cluster_23,
    Data11=cluster_22,
    Data12=cluster_21,
    Data13=cluster_20,
    Data14=cluster_19,
    Data15=cluster_17,
    Data16=cluster_15,
    Data17=cluster_14,
    Data18=cluster_8,
    Data19=cluster_9,
    Data20=cluster_7,
    Data21=cluster_6,
    Data22=cluster_3,
    Data23=cluster_2,
    Data24=cluster,
    Data25=cluster_18,
    Data26=cluster_16,
    Data27=cluster_13,
    Data28=cluster_10,
    Data29=cluster_12,
    Data30=cluster_11,
    Data31=cluster_5,
    Data32=cluster_4,
    Data33=cluster_33,
    Data34=cluster_35,
    Data35=cluster_34)
preview = CustomPreview(Geometry=merge, Material=ColourSwatch(SwatchColor=RGB(0, 0, 0)))

# ==== cluster Cluster
i = ClusterInput()
L = ClusterInput()
S = ClusterInput()
multiplication = Multiplication(A=i, B=2)
lng = ListLength(List=L)
subtraction = Subtraction(A=lng)
addition = Addition(A=S, B=4)
random = Random(Range=subtraction, Number=multiplication, Seed=addition)
random_2 = Random(Range=Domain(0, 1), Number=multiplication, Seed=S)
round = Round(Number=random)  # -> Nearest, Floor, Ceiling
split = SplitList(List=round.Nearest, Index=i)  # -> flatten(ListA), flatten(ListB)
split_2 = SplitList(List=random_2, Index=i)  # -> flatten(ListA), flatten(ListB)
item = ListItem(List=L, Index=split.ListA, Wrap=True)
item_2 = ListItem(List=L, Index=split.ListB, Wrap=True)
eval = EvaluateCurve(Curve=reparameterize(item_2), Parameter=split_2.ListA)  # -> Point, Tangent, Angle
eval_2 = EvaluateCurve(Curve=reparameterize(item), Parameter=split_2.ListB)  # -> Point, Tangent, Angle
ln = Line(StartPoint=eval.Point, EndPoint=eval_2.Point)
L_2 = ClusterOutput(ln)
