# Grasshopper definition testbox.gh (Grasshopper 1.0.7)
# plug-ins: LunchBox, Wombat, NGon, Human

pipeline = GeometryPipeline(
    GroupByLayer=False,
    GroupByType=False,
    IncludeHidden=True,
    IncludeLocked=True,
    LayerFilter="*bbox",
    NameFilter="*",
    SublayerFiltering=True,
    TypeFilter=1073741848)
debrep = DeconstructBrep(Brep=pipeline)  # -> Faces, Edges, Vertices
mesh = Mesh(<mesh referenced from the Rhino model>)
pipeline_2 = GeometryPipeline(
    GroupByLayer=False,
    GroupByType=False,
    IncludeHidden=True,
    IncludeLocked=True,
    LayerFilter="nonfixed",
    NameFilter="*",
    SublayerFiltering=True,
    TypeFilter=4)
bbox = BoundingBox(Content=pipeline, Plane=PlaneXY(0, 0, 0))  # -> Box, Box_2
pipeline_3 = GeometryPipeline(
    GroupByLayer=False,
    GroupByType=False,
    IncludeHidden=True,
    IncludeLocked=True,
    LayerFilter="fixed",
    NameFilter="*",
    SublayerFiltering=True,
    TypeFilter=4)
pt = Point([<point referenced from the Rhino model> x144])
brep = Brep()
debox = DeconstructBox(Box=bbox.Box)  # -> Plane, X, Y, Z
demesh = DeconstructMesh(Mesh=mesh)  # -> Vertices, Faces, Colours, Normals
dedomain = DeconstructDomain(Domain=debox.Z)  # -> Start, End
panel = Panel(debrep.Vertices)
dedomain_2 = DeconstructDomain(Domain=debox.Y)  # -> Start, End
merge = Merge(Data1=pipeline_3, Data2=pipeline_2)
subtraction = Subtraction(A=dedomain.End, B=dedomain.Start)
number_slider = Slider(1000, range=0..1000)
dedomain_3 = DeconstructDomain(Domain=debox.X)  # -> Start, End
number_slider_2 = Slider(10, range=10..1000)
crv = Curve(merge)
explode = Explode(Curve=crv, Recursive=True)  # -> Segments, Vertices
subtraction_2 = Subtraction(A=dedomain_2.End, B=dedomain_2.Start)
subtraction_3 = Subtraction(A=dedomain_3.End, B=dedomain_3.Start)
number_slider_3 = Slider(0.1, range=0.01..0.1)
lng = ListLength(List=pipeline_3)
lng_2 = ListLength(List=pipeline_2)
voxels = Voxels(Scale=1)
popgeo = PopulateGeometry(Geometry=pipeline, Count=100, Seed=1)
end = EndPoints(Curve=explode.Segments)  # -> Start, End
range = Range(Domain=debox.X, Steps=subtraction_3)
range_2 = Range(Domain=debox.Y, Steps=subtraction_2)
range_3 = Range(Domain=debox.Z, Steps=subtraction)
pt_2 = Point(demesh.Vertices)
pdecon = Deconstruct(Point=pt_2)  # -> XComponent, YComponent, ZComponent
multiplication = Multiplication(A=pdecon.ZComponent, B=number_slider)
multiplication_2 = Multiplication(A=pdecon.YComponent, B=number_slider)
multiplication_3 = Multiplication(A=pdecon.XComponent, B=number_slider)
round = Round(Number=multiplication)  # -> Nearest, Floor, Ceiling
round_2 = Round(Number=multiplication_3)  # -> Nearest, Floor, Ceiling
round_3 = Round(Number=multiplication_2)  # -> Nearest, Floor, Ceiling
division = Division(A=round.Nearest, B=number_slider)
division_2 = Division(A=round_2.Nearest, B=number_slider)
division_3 = Division(A=round_3.Nearest, B=number_slider)
pipeline_4 = GeometryPipeline(
    GroupByLayer=False,
    GroupByType=False,
    IncludeHidden=True,
    IncludeLocked=True,
    LayerFilter="densityboxes::middensity",
    NameFilter="*",
    SublayerFiltering=True,
    TypeFilter=1073741848)
pipeline_5 = GeometryPipeline(
    GroupByLayer=False,
    GroupByType=False,
    IncludeHidden=True,
    IncludeLocked=True,
    LayerFilter="densityboxes::highdensity",
    NameFilter="*",
    SublayerFiltering=True,
    TypeFilter=1073741848)
pipeline_6 = GeometryPipeline(
    GroupByLayer=False,
    GroupByType=False,
    IncludeHidden=True,
    IncludeLocked=True,
    LayerFilter="densityboxes::nodensity",
    NameFilter="*",
    SublayerFiltering=True,
    TypeFilter=1073741848)
series = Series(Start=debox.X, Step=1, Count=10)
crossref = CrossReference(ListA=range, ListB=range_2, CrossMode=1)  # -> ListA, ListB
pt_3 = ConstructPoint(XCoordinate=division_2, YCoordinate=division_3, ZCoordinate=division)
sort_pts = SortDuplicatePoints(Points=flatten(pt_3))  # -> UniquePoints, Indices
cp = ClosestPoint(Point=explode.Vertices, Cloud=sort_pts.UniquePoints)  # -> ClosestPoint, CPIndex, Distance
cp_2 = ClosestPoint(Point=explode.Vertices, Cloud=sort_pts.UniquePoints)  # -> ClosestPoint, CPIndex, Distance
addition = Addition(A=cp.CPIndex, B=1)
repeat = RepeatData(Data=Slider(1, range=0..100), Length=lng)
repeat_2 = RepeatData(Data=Slider(0, range=0..1), Length=lng_2)
item = ListItem(List=addition, Index=1, Wrap=True)  # -> simplify(Item)
item_2 = ListItem(List=addition, Index=0, Wrap=True)  # -> simplify(Item)
pt_4 = ConstructPoint(XCoordinate=crossref.ListA, YCoordinate=crossref.ListB, ZCoordinate=graft(range_3))  # -> flatten(Point)
pdecon_2 = Deconstruct(Point=sort_pts.UniquePoints)  # -> XComponent, YComponent, ZComponent
lng_3 = ListLength(List=pt_4)
panel_2 = Panel(pt_2)
merge_2 = Merge(Data1=repeat, Data2=repeat_2)
brepsinc = PointInBreps(Brep=pipeline_4, Point=pt_4, Strict=False)  # -> Inside, Index
createatts = CreateAttributes(enableFullPath=False)
brepsinc_2 = PointInBreps(Brep=pipeline_5, Point=pt_4, Strict=False)  # -> Inside, Index
brepsinc_3 = PointInBreps(Brep=pipeline_6, Point=pt_4, Strict=False)  # -> Inside, Index
repeat_3 = RepeatData(Data=Slider(0.05, range=0..1), Length=lng_3)
concat = Concatenate(FragmentA="l", FragmentB=item_2, FragmentC=item, FragmentD=graft(merge_2), JoinSeparator=" ")  # -> flatten(Result)
dpipeline = DynamicGeometryPipeline(
    LayerFilter="points*",
    TypeFilter="Point",
    NameFilter="*",
    GroupByLayer=False,
    GroupByType=False,
    IncludeHidden=True,
    IncludeLocked=True,
    enableFullPath=True,
    listenToAttributes=True)
concat_2 = Concatenate()
cull = CullPattern(List=pt_4, CullPattern=brepsinc_2.Inside)
cp_3 = ClosestPoint(Point=sort_pts.UniquePoints, Cloud=dpipeline)  # -> ClosestPoint, CPIndex, Distance
not = GateNot(A=brepsinc_3.Inside)
num = Number(not)
num_2 = Number(brepsinc.Inside)
num_3 = Number(brepsinc_2.Inside)
objatts = ObjectAttributes(ObjectOrAttributes=dpipeline)  # -> Name, LayerName, LayerFullPath, Color, MaterialName, LinetypeName, GroupIndices, PlotWeight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
max = Maximum(A=repeat_3, B=num_3)
multiplication_4 = Multiplication()
pt_5 = Point([<point referenced from the Rhino model> x15])
multiplication_5 = Multiplication(A=num_2, B=Slider(0.4, range=0..1))
expression = Expression(x=objatts.LayerName, y="unfixed", Expression="if(x=y,0,1)")
vec = Vector(pt_5)
max_2 = Maximum(A=max, B=multiplication_5)
min = Minimum(A=max_2, B=num)
multiplication_6 = Multiplication(A=min, B=255)
panel_3 = Panel(vec)
item_3 = ListItem(List=expression, Index=cp_3.CPIndex, Wrap=True)  # -> simplify(flatten(Item))
panel_4 = Panel(item_3)
pdecon_3 = Deconstruct(Point=pt_4)  # -> XComponent, YComponent, ZComponent
rgb = ColourRGB(Alpha=Slider(100, range=0..100), Red=multiplication_6, Green=multiplication_6, Blue=multiplication_6)
panel_5 = Panel("\")
int = Integer(pdecon_3.XComponent)
panel_6 = Panel("D:\Dokumente\Uni\programmieren\cindertesting\experiments\pointcloud\")
int_2 = Integer(pdecon_3.YComponent)
int_3 = Integer(pdecon_3.ZComponent)
cloud = CloudDisplay(Points=pt_4, Colours=rgb, Size=Slider(0.213, range=0.001..1), SpriteType=1)
panel_7 = Panel(".obj")
concat_3 = Concatenate(FragmentA=int, FragmentB=int_3, FragmentC=int_2, FragmentD=min, JoinSeparator=",")
button = Button()
path = FilePath(panel_6)
concat_4 = Concatenate(FragmentA=path, FragmentC="initialgraph", FragmentD=".txt")
python = GhPythonScript()  # -> out, a
# ---------- python: Python ----------
__author__ = "ed"
__version__ = "2023.04.24"

import rhinoscriptsyntax as rs
a = ghenv.Component.OnPingDocument().FilePath

#a = "hello"
# ---------- end python ----------
brep_2 = Brep(<brep referenced from the Rhino model>)
concat_5 = Concatenate(FragmentA=path, FragmentC="voxels", FragmentD=".txt")
popgeo_2 = PopulateGeometry(Geometry=brep_2, Count=100, Seed=1)
pt_6 = Point([<point referenced from the Rhino model> x7])
number_slider_4 = Slider(1, range=-5..5)
split = TextSplit(Text=python.a, Separators="\")
pdecon_4 = Deconstruct(Point=popgeo_2)  # -> XComponent, YComponent, ZComponent
writetxt = WriteToTextFile(Run=[button, Button()], TextToWrite=concat_3, FilePath=concat_5, Append=False, NewOnly=False)
split_2 = SplitList(List=reverse(split), Index=1)  # -> ListA, reverse(simplify(flatten(ListB)))
concat_6 = Concatenate(FragmentA=path, FragmentC="anchorpoints", FragmentD=".txt")
concat_7 = Concatenate(
    FragmentA="v",
    FragmentB=pdecon_2.XComponent,
    FragmentC=pdecon_2.ZComponent,
    FragmentD=pdecon_2.YComponent,
    FragmentE=item_3,
    JoinSeparator=" ")
merge_3 = Merge(Data1=concat_7, Data3=concat)
writetxt_2 = WriteToTextFile(Run=True, TextToWrite=concat_7, Append=False, NewOnly=False)
panel_11 = Panel(concat_7)
panel_12 = Panel(merge_3)
writetxt_3 = WriteToTextFile(Run=button, TextToWrite=merge_3, FilePath=concat_4, Append=False, NewOnly=False)
panel_13 = Panel(writetxt_3)
int_4 = Integer(pdecon_4.XComponent)
merge_4 = Merge(Data1=split_2.ListB, Data2="initialPoints.obj")  # -> simplify(Result)
int_5 = Integer(pdecon_4.YComponent)
panel_14 = Panel(writetxt)
int_6 = Integer(pdecon_4.ZComponent)
concat_8 = Concatenate(FragmentA=int_4, FragmentB=int_6, FragmentC=int_5, JoinSeparator=",")
join = TextJoin(Text=merge_4, Join="\")
writetxt_4 = WriteToTextFile(Run=Button(), TextToWrite=join, FilePath=concat_7, Append=False, NewOnly=False)
panel_15 = Panel(concat_8)
writetxt_5 = WriteToTextFile(Run=Button(), TextToWrite=concat_8, FilePath=concat_6, Append=False, NewOnly=False)
